# Dynamo graph Example.dyn (Dynamo 0.7.1.9068)

string = StringInput("""Mares eat oats.
And does eat oats.
And little lambs eat ivy.
I would eat ivy too, wouldn't you?""")
number = DoubleInput(0..150..#10)
byCoordinates = Point.ByCoordinates(arg1=number)
number_2 = DoubleInput(1..10)
fromStringOriginAndScale = DynamoText.Text.FromStringOriginAndScale(string, byCoordinates, number_2)
